# Grasshopper definition one_over_x_for_hops_testing.gh (Grasshopper 1.0.7)

X = GetNumber(AtLeast=1, AtMost=1, Maximum=1.797693135e+308, Minimum=-1.797693135e+308, TreeAccess=False)
one_over_x = OneOverX(Value=X)
c_script = CSharpScript(y=one_over_x)  # -> out, Report; inputs y: Double
# ---------- c_script: C# ----------
    Report = ((y < 1) ? "Less than one" : (y == 1) ? "Equal to one" : "Greater than one");
# ---------- end c_script ----------

# ---- group: RH_OUT:Y
num = Number(one_over_x)

# ---- group: RH_OUT:Report
txt = Text(c_script.Report)
